# Grasshopper definition stretched_cpp.ghx (Grasshopper 1.0.7)
# plug-ins: NGon, Kangaroo2 Components, Pufferfish

number_slider = Slider(1.3, range=0..10)
multiplication = Multiplication(A="4.532151655555558", B=number_slider)

number_slider_2 = Slider(5, range=0..10)
Y = UnitY(Factor=1)
crv = Curve(<curve referenced from the Rhino model>)
multiplication_2 = Multiplication(A=Y, B=multiplication)
division = Division(A=Slider(1211, range=1000..1300), B=multiplication)
int = Integer(division)
series = Series(Start=Slider(0, range=0..100), Step=multiplication, Count=int)
pt = ConstructPoint(XCoordinate=0, YCoordinate=series, ZCoordinate=0)
move = Move(Geometry=crv, Motion=pt)  # -> Geometry, Transform
crv_2 = Curve(<curve referenced from the Rhino model>)
pln = Plane(crv_2)
trim = TrimWithRegion(Curve=move.Geometry, Region=crv_2, Plane=pln)  # -> Inside, Outside
geo = Geometry(flatten(trim.Inside))

len = Length(Curve=crv)
mesh = Mesh(<mesh referenced from the Rhino model>)
# Add the boundary vertices
mesh_2 = Mesh(<mesh referenced from the Rhino model>)
pt_2 = Point(<point referenced from the Rhino model>)
python = GhPythonScript(R_mesh=mesh_2)  # -> out, mesh; inputs R_mesh: Mesh
# ---------- python: Python ----------
__author__ = "duchaoyu"

import Rhino.Geometry as rg
import scriptcontext as sc
from compas.utilities import geometric_key


mesh = sc.sticky['R_mesh_to_C'](R_mesh)
# ---------- end python ----------
pdecon = Deconstruct(Point=pt_2)  # -> XComponent, YComponent, ZComponent
python_2 = GhPythonScript(i_mesh=python.mesh, cen_pt=pt_2, dis="25")  # -> out, mesh; inputs cen_pt: Point3d, dis: Int32
# ---------- python_2: Python ----------
__author__ = "duch"

import rhinoscriptsyntax as rs
from compas.geometry import subtract_vectors
from compas.geometry import normalize_vector
from compas.geometry import scale_vector
from compas.geometry import add_vectors

mesh = i_mesh.copy()

bdrs = mesh.vertices_on_boundary()
print(bdrs)
cen = [cen_pt.X, cen_pt.Y, cen_pt.Z]

bdrs_dict = {}
for vkey in bdrs[:-1]:
    xyz = mesh.vertex_coordinates(vkey)
    dir = subtract_vectors(xyz, cen)
    dir_unit = normalize_vector(dir)
    dir_scaled = scale_vector(dir_unit, dis)
    
    new_xyz = add_vectors(xyz, dir_scaled)
    new_vkey = mesh.add_vertex(x=new_xyz[0], y= new_xyz[1], z=new_xyz[2])
    bdrs_dict[vkey] = new_vkey
    



for (a,b) in zip(bdrs[:-1], bdrs[1:]):
    print(a, b)
    a_new = bdrs_dict[a]
    b_new = bdrs_dict[b]
    
    mesh.add_face([a, b, a_new])
    mesh.add_face([b, b_new, a_new])
# ---------- end python_2 ----------
srf = Surface(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)
mesh_3 = Mesh(<mesh referenced from the Rhino model>)
medges = MeshEdges(Mesh=mesh_3)  # -> NakedEdges, InteriorEdges, NonManifoldEdges
pt_3 = Point(<point referenced from the Rhino model>)
crv_3 = Curve([<curve referenced from the Rhino model> x48])
pt_4 = Point(<point referenced from the Rhino model>)
python_3 = GhPythonScript(mesh=python_2.mesh)  # -> out, R_mesh
# ---------- python_3: Python ----------
__author__ = "duchaoyu"

import scriptcontext as sc 

R_mesh = sc.sticky['mesh_to_R'](mesh)
# ---------- end python_3 ----------
pdecon_2 = Deconstruct(Point=pt_3)  # -> XComponent, YComponent, ZComponent
srf_cp = SurfaceClosestPoint(Point=[pt_4, pt_3], Surface=srf)  # -> Point, UVPoint, Distance
join = JoinCurves(Curves=crv_3, Preserve=False)
pdecon_3 = Deconstruct(Point=pt_4)  # -> XComponent, YComponent, ZComponent
project = ProjectPoint(Point=pt_4, Direction=Vector(0, 0, -1), Geometry=srf)  # -> Point, Index
panel = Panel(pdecon_2.XComponent)
panel_2 = Panel(pdecon_2.YComponent)
crv_4 = Curve(<curve referenced from the Rhino model>)
panel_3 = Panel(pdecon_3.XComponent)
panel_4 = Panel(pdecon_3.YComponent)
evalsrf = EvaluateSurface(Surface=srf, Point=srf_cp.UVPoint)  # -> Point, Normal, UDirection, VDirection, Frame
len_2 = Length(Curve=join)
panel_5 = Panel(srf_cp.UVPoint)
python_4 = GhPythonScript()
# ---------- python_4: Python ----------
__author__ = "duchaoyu"

import rhinoscriptsyntax as rs
import scriptcontext as sc
import Rhino.Geometry as rg
from compas.datastructures import Mesh
from compas.geometry import centroid_points
from compas.utilities import pairwise

def point_to_R(point):
    x= point[0]
    y = point[1]
    z = point[2]
    return rg.Point3d(x, y, z)

def vector_to_R(vector):
    x = vector[0]
    y = vector[1]
    z = vector[2]
    return rg.Vector3d(x, y, z)

def line_to_R(line):
    st = line[0]
    ed = line[1]
    st_pt = rg.Point3d(st[0], st[1], st[2])
    ed_pt = rg.Point3d(ed[0], ed[1], ed[2])
    return rg.Line(st_pt, ed_pt)

def polygon_to_R(polygon):
    if isinstance(polygon, list):
        points = polygon
    else:
        points = polygon.points
    R_points = []
    for pt in points:
        R_pt = rg.Point3d(pt[0], pt[1], pt[2])
        R_points.append(R_pt)
    R_points.append(rg.Point3d(points[0][0], points[0][1], points[0][2]))
    return rg.Polyline(R_points)

def polyline_to_R(polyline):
    if isinstance(polyline, list):
        points = polyline
    else:
        points = polyline.points
    R_points = []
    polyline = rg.Polyline()
    for pt in points:
        polyline.Add(pt[0], pt[1], pt[2])
    return polyline

def circle_to_R(circle):
    p = circle.plane
    r = circle.radius
    origin = rg.Point3d(p.point[0], p.point[1], p.point[2])
    normal = rg.Vector3d(p.normal[0], p.normal[1], p.normal[2])
    return rg.Circle(rg.Plane(origin, normal), r)

def plane_to_R(plane):
    pt = plane[0]
    normal = plane[1]
    return rg.Plane(rg.Point3d(*pt), rg.Vector3d(*normal))

def netwrok_to_R(network):
    R_lines = []
    for (u, v) in network.edges():
        u_xyz, v_xyz = network.edge_coordinates(u, v)
        line = rg.Line(rg.Point3d(*u_xyz), rg.Point3d(*v_xyz))
        R_lines.append(line)
    return R_lines

def mesh_to_R(mesh):
    R_mesh = rg.Mesh()
    key_count_dict = {}
    count = 0
    for vkey in mesh.vertices():
        x, y, z = mesh.vertex_coordinates(vkey)
        R_mesh.Vertices.Add(rg.Point3d(float(x), float(y), float(z)))
        key_count_dict[vkey] = count
        count += 1
    for fkey in mesh.faces():
        f_vkeys = mesh.face_vertices(fkey)
        f_vkeys = [key_count_dict[key] for key in f_vkeys]
        if len(f_vkeys) <= 4:
            R_mesh.Faces.AddFace(*f_vkeys)
        else:
            centroid = centroid_points([mesh.vertex_coordinates(vkey) for vkey in f_vkeys])
            c = R_mesh.Vertices.Add(rg.Point3d(*centroid))
            facets = []
            for i, j in pairwise(f_vkeys + f_vkeys[:1]):
                facets.append(R_mesh.Faces.AddFace(i, j, c))
            ngon = rg.MeshNgon.Create(f_vkeys, facets)
            R_mesh.Ngons.AddNgon(ngon)
    R_mesh.Normals.ComputeNormals()
    R_mesh.Compact()
    return R_mesh


def R_mesh_to_C(R_mesh):
    vertices = []
    faces = []

    for pt in R_mesh.Vertices:
        vertices.append([float(pt.X), float(pt.Y), float(pt.Z)])
        
    for face in R_mesh.Faces:
        if face.IsQuad:
            faces.append([face.A, face.B, face.C, face.D])
        else:
            faces.append([face.A, face.B, face.C]) 
  

    C_mesh = Mesh.from_vertices_and_faces(vertices, faces)
    return C_mesh
  


sc.sticky['polygon_to_R'] = polygon_to_R
sc.sticky['polyline_to_R'] = polyline_to_R
sc.sticky['circle_to_R'] = circle_to_R
sc.sticky['point_to_R'] = point_to_R
sc.sticky['vector_to_R'] = vector_to_R
sc.sticky['line_to_R'] = line_to_R
sc.sticky['plane_to_R'] = plane_to_R
sc.sticky['netwrok_to_R'] = netwrok_to_R
sc.sticky['mesh_to_R'] = mesh_to_R
sc.sticky['R_mesh_to_C'] = R_mesh_to_C
# ---------- end python_4 ----------
panel_6 = Panel(len_2)
panel_7 = Panel("/Users/duch/Documents/PhD/paper/2024_fofin/base_geometry_tri_path_recons.txt")
panel_8 = Panel("file:///Users/duch/Downloads/circpack_dome.gh")
panel_9 = Panel("/Users/duch/Documents/PhD/paper/2024_fofin/prototype_tri_path_recons_exp.txt")

# ----
# 1. Read Stripes, If needed, manual fix
panel_10 = Panel("/Users/duch/Documents/PhD/knit/2024_prototypes/callibration/flat_no_shortrows")
panel_11 = Panel("flat_no_shortrows_prestrain")
python_5 = GhPythonScript(input_path=panel_10, filename=panel_11)  # -> out, exp_path
# ---------- python_5: Python ----------
__author__ = "duch"

import rhinoscriptsyntax as rs
import os 


exp_path = os.path.join(input_path, filename+"_tri_path.txt")
print(exp_path)
# ---------- end python_5 ----------
panel_12 = Panel(python_5.exp_path)

# ---- group: read_recons_polylines and ordered
python_6 = GhPythonScript(file_path=panel_9)  # -> out, polylines
# ---------- python_6: Python ----------
__author__ = "duch"

import rhinoscriptsyntax as rs
import Rhino.Geometry as rg
import os 


file_path = os.path.abspath(file_path)
polylines = []
with open(file_path, 'r') as file:
    for line in file:
        # Remove whitespace and newline characters, then split by semicolon
        point_strs = line.strip().split('; ')
        if point_strs != ['']:

            polyline = [list(map(float, point.split(','))) for point in point_strs]
            polylines.append(polyline)
# ---------- end python_6 ----------
python_7 = GhPythonScript(polylines=python_6.polylines)  # -> out, geos; inputs polylines: list
# ---------- python_7: Python ----------
__author__ = "duch"

import rhinoscriptsyntax as rs
import scriptcontext as sc
from compas.geometry import Polyline

geos = []
for polyline in polylines:
    print(polyline[0], polyline[-1])
    p = Polyline(polyline)
    geos.append(sc.sticky['polyline_to_R'](p))
# ---------- end python_7 ----------

# ----
python_8 = GhPythonScript(file_path=python_5.exp_path)  # -> out, polylines
# ---------- python_8: Python ----------
__author__ = "duch"

import rhinoscriptsyntax as rs
import Rhino.Geometry as rg

print(file_path)
polylines = []
with open(file_path, 'r') as file:
    for line in file:
        # Remove whitespace and newline characters, then split by semicolon
        point_strs = line.strip().split('; ')
        polyline = [list(map(float, point.split(','))) for point in point_strs]
        polylines.append(polyline)

print(len(polylines))
print(polylines)
# ---------- end python_8 ----------
python_9 = GhPythonScript(polylines=python_8.polylines)  # -> out, geos; inputs polylines: list
# ---------- python_9: Python ----------
__author__ = "duch"

import rhinoscriptsyntax as rs
import scriptcontext as sc
from compas.geometry import Polyline

geos = []
for polyline in polylines:
    p = Polyline(polyline)
    geos.append(sc.sticky['polyline_to_R'](p))
# ---------- end python_9 ----------

number_slider_3 = Slider(2, range=0..10)
number_slider_4 = Slider(2, range=0..10)  # disabled
number_slider_5 = Slider(2, range=0..10)  # disabled
panel_13 = Panel("0.05")
panel_14 = Panel("8, 0, 5, 1, 9, 6, 2, 3, 4, 7, 16, 37, 33, 23, 13, 21, 20, 36, 32, 46, 40, 44, 27, 28, 38, 10, 11, 39, 24, 42, 26, 25, 31, 34, 45, 15, 12, 22, 43, 17, 14, 41, 18, 47, 35, 30, 29")
Y_2 = UnitY(Factor=1)
python_10 = GhPythonScript(input_path=panel_10, filename=panel_11, feature="pattern")  # -> out, exp_path
# ---------- python_10: Python ----------
__author__ = "duch"

import rhinoscriptsyntax as rs
import os 


exp_path = os.path.join(input_path, filename+"_feature_" + feature + ".txt")
print(exp_path)
# ---------- end python_10 ----------
python_11 = GhPythonScript(input_path=panel_10, filename=panel_11, feature="soft")  # -> out, exp_path; same code as python_10
python_12 = GhPythonScript(input_path=panel_10, filename=panel_11, feature="tiles")  # -> out, exp_path; same code as python_10
panel_15 = Panel("1")  # disabled
panel_16 = Panel("0")  # disabled
pt_5 = Point([<point referenced from the Rhino model> x48])
panel_17 = Panel(python_10.exp_path)
panel_18 = Panel(python_11.exp_path)
panel_19 = Panel(python_12.exp_path)
crv_5 = Curve([<curve referenced from the Rhino model> x7])
crv_6 = Curve([<curve referenced from the Rhino model> x3])
reparamcrv = ReparameterizeCurve(Curve=crv_5)  # -> Reparameterized, Original
merge = Merge(Data1=crv_5, Data2=crv_6)
number_slider_6 = Slider(-0.25, range=-1..0.1)  # disabled
pt_6 = Point([<point referenced from the Rhino model> x377])
pt_7 = Point([<point referenced from the Rhino model> x3033])
pt_8 = Point([<point referenced from the Rhino model> x259])
pt_9 = Point([<point referenced from the Rhino model> x259])
pt_10 = Point([<point referenced from the Rhino model> x259])
pt_11 = Point([<point referenced from the Rhino model> x259])
multiplication_3 = Multiplication(A="5", B=number_slider)
merge_2 = Merge(Data1=pt_8, Data2=pt_9, Data3=pt_10, Data4=pt_11)
python_13 = GhPythonScript(input_path=panel_10, filename=panel_11, feature="_vertex_directional_field")  # -> out, exp_path
# ---------- python_13: Python ----------
__author__ = "duch"

import rhinoscriptsyntax as rs
import os 


exp_path = os.path.join(input_path, filename+ feature + ".txt")
print(exp_path)
# ---------- end python_13 ----------
panel_20 = Panel(python_13.exp_path)
mesh_4 = Mesh(<mesh referenced from the Rhino model>)
faceb = FaceBoundaries(Mesh=mesh_4)
boundary = BoundarySurfaces(Edges=faceb)
join_2 = BrepJoin(Breps=boundary)  # -> Breps, Closed

# ---- group: features
# 2.5 Features
python_14 = GhPythonScript(input_path=panel_10, filename=panel_11)  # -> out, exp_path
# ---------- python_14: Python ----------
__author__ = "duch"

import rhinoscriptsyntax as rs
import os 


exp_path = os.path.join(input_path, filename+"_feature.txt")
print(exp_path)
# ---------- end python_14 ----------
panel_21 = Panel(python_14.exp_path)
pt_12 = Point([<point referenced from the Rhino model> x299])

# ----
mesh_5 = Mesh(<mesh referenced from the Rhino model>)
pt_13 = Point([<point referenced from the Rhino model> x3])
# Face Keys for Directional Field
demesh = DeconstructMesh(Mesh=mesh_5)  # -> Vertices, Faces, Colours, Normals
python_15 = GhPythonScript(R_mesh=mesh_5)  # -> out, mesh; inputs R_mesh: Mesh; same code as python
python_16 = GhPythonScript(mesh=python_15.mesh, pts=pt_13)  # -> out, sel_faces; inputs pts: list of Point3d
# ---------- python_16: Python ----------
__author__ = "duchaoyu"

import Rhino.Geometry as rg
import scriptcontext as sc
from compas_rv3.datastructures import Pattern
from compas_rv3.datastructures import FormDiagram
from compas.utilities import geometric_key



gkey_key_dict = {}
for vkey in mesh.vertices():
    xyz = mesh.vertex_coordinates(vkey)
    geo_key = geometric_key(xyz)
    gkey_key_dict[geo_key] = vkey

sel_vkeys = []
for pt in pts:
    x = float(pt.X)
    y = float(pt.Y)
    z = float(pt.Z)
    xyz = [x, y, z]
    geo_key = geometric_key(xyz)
    vkey = gkey_key_dict[geo_key]
    sel_vkeys.append(vkey)

sel_faces = []
for face in mesh.faces():
    vkeys = mesh.face_vertices(face)
    for vkey in vkeys:
        if vkey in sel_vkeys:
            sel_faces.append(face)


sel_faces_set = set(sel_faces)
sel_faces = list(sel_faces_set)
print(sel_faces)
# ---------- end python_16 ----------
panel_22 = Panel(python_16.out)
data = Data(python_15.mesh)
python_17 = GhPythonScript(mesh=data)  # -> out, R_mesh; same code as python_3

python_18 = GhPythonScript(mesh=data, showedgelabels=Toggle(False))  # -> R_m_points, edgelabels; inputs showedgelabels: Boolean
# ---------- python_18: Python ----------
__author__ = "duchaoyu"

import rhinoscriptsyntax as rs
import scriptcontext as sc

R_m_points = []
edgelabels = []

# access edges
for u, v in mesh.edges(): # u, v: two vertices that the edge connect
    m_xyz = mesh.edge_midpoint(u, v) # middle point of the edge
    R_m_point = sc.sticky['point_to_R'](m_xyz)
    R_m_points.append(R_m_point)
    
    if showedgelabels:
        edgelabels.append("{}-{}".format(u, v))
# ---------- end python_18 ----------
pt_14 = Point(python_18.R_m_points)
tag = TextTag3D(
    Location=python_18.R_m_points,
    Text=python_18.edgelabels,
    Size=Slider(0.22, range=0..1),
    Colour=ColourSwatch(SwatchColor=RGB(255, 0, 0)),
    Justification=5)

python_19 = GhPythonScript(mesh=data, showhalfedges=Toggle(False), hideNonefaces=Toggle(False))  # -> R_points, R_vectors; inputs showhalfedges: Boolean, hideNonefaces: Boolean
# ---------- python_19: Python ----------
__author__ = "duchaoyu"

import scriptcontext as sc
import System.Drawing as sd
from compas.geometry import Line, Frame, Scale, offset_line

R_points = []
R_vectors = []

distance = 0.1
shrink = 0.7

if showhalfedges:
    for (u, v) in mesh.edges():
        halfedges = [(u, v), (v, u)]
        for (u, v) in halfedges: 
            fkey = mesh.halfedge_face(u, v)
            
            if hideNonefaces: 
                if fkey is None:
                    continue
            
            if fkey is None:
                normal = mesh.face_normal(mesh.halfedge_face(v, u))
            else:
                normal = mesh.face_normal(fkey)
                
            a, b = mesh.edge_coordinates(u, v)
            line = Line(*offset_line((a, b), distance, normal))
            frame = Frame(line.midpoint, [1, 0, 0], [0, 1, 0])
            scale = Scale.from_factors([shrink, shrink, shrink], frame=frame)
            line.transform(scale)
            dir = [(b - a) for a, b in zip(line[0], line[1])]
            
            R_points.append(sc.sticky['point_to_R'](line[0]))
            R_vectors.append(sc.sticky['vector_to_R'](dir))
# ---------- end python_19 ----------
vec = Vector(python_19.R_vectors)
pt_15 = Point(python_19.R_points)
vdis = VectorDisplay(Anchor=pt_15, Vector=vec)

# ---- group: reconstrct polylines for correct spacing
# 2. Reconstrct mesh, Define Warp Distance
pt_16 = Point(Point(604.1311947, -603.2839243, -200))
pt_17 = Point(Point(604.1311947, 604.9170827, -200))
geo_2 = Geometry([<curve referenced from the Rhino model> x293])
Z = UnitZ(Factor=1)
ln = Line(StartPoint=pt_17, EndPoint=pt_16)
pl = ConstructPlane(Origin=pt_17, XAxis=ln, YAxis=Z)
rebcrv = RebuildCurve(Curve=geo, EndTangents=False)
python_20 = GhPythonScript(curves=rebcrv, plane=pl)  # -> out, out_curves; inputs curves: list of Curve, plane: Plane
# ---------- python_20: Python ----------
__author__ = "duch"

import rhinoscriptsyntax as rs
import ghpythonlib.components as gh

import Rhino.Geometry as rg


tol = 10


out_curves = []
for crv in curves:
    st = crv.PointAt(0)
    # st, ed = gh.EndPoints(crv)


    closest_st = plane.ClosestPoint(st)
    
    dis = st.DistanceTo(closest_st)
    if dis > tol: 
        # flip_crv = gh.FlipCurve(crv)[0]
        crv.Reverse()
        out_curves.append(crv)
        # out_curves.append(flip_crv)
    else:
        out_curves.append(crv)
# ---------- end python_20 ----------
panel_23 = Panel("3.59054138888889")
end = EndPoints(Curve=python_20.out_curves)  # -> Start, End
python_21 = GhPythonScript(input_path=panel_12)  # -> out, exp_path
# ---------- python_21: Python ----------
__author__ = "duch"

import rhinoscriptsyntax as rs
import os 


a, b = input_path.split(".")
exp_path = a + "_recons." + b
# ---------- end python_21 ----------
pt_18 = Point(end.Start)
dam = DataDam(DataA=python_20.out_curves, BufferDelay=10000000, BufferMode=0)
panel_24 = Panel(python_21.exp_path)

# ---- group: read_recons_polylines(not ordered yet)
# 3. Order Polylines (Python)
python_22 = GhPythonScript(file_path=panel_24)  # -> out, polylines; same code as python_6
python_23 = GhPythonScript(polylines=python_22.polylines)  # -> out, geos; inputs polylines: list
# ---------- python_23: Python ----------
__author__ = "duch"

import rhinoscriptsyntax as rs
import scriptcontext as sc
from compas.geometry import Polyline

geos = []


for polyline in polylines:
    print(polyline[0], polyline[-1])
    p = Polyline(polyline)
    geos.append(sc.sticky['polyline_to_R'](p))
# ---------- end python_23 ----------

# ----
python_24 = GhPythonScript(polylines=python_22.polylines)  # -> out, geos; inputs polylines: list
# ---------- python_24: Python ----------
__author__ = "duch"

import rhinoscriptsyntax as rs
import scriptcontext as sc
from compas.geometry import Polyline

geos = []
for polyline in polylines:
    for pt in polyline:
        geos.append(sc.sticky['point_to_R'](pt))
# ---------- end python_24 ----------
item = ListItem(List=python_24.geos, Index=["2326", "2337"], Wrap=True)
python_25 = GhPythonScript(polylines=python_22.polylines)  # -> out, geos; inputs polylines: list
# ---------- python_25: Python ----------
__author__ = "duch"

import rhinoscriptsyntax as rs
import scriptcontext as sc
from compas.geometry import Polyline

geos = []

order_dict={237: False, 1: True, 27: False, 28: True, 0: False, 44: True, 42: True, 43: False, 41: False, 26: True, 23: True, 22: False, 21: True, 20: False, 25: True, 24: False, 19: True, 18: False, 16: False, 15: True, 11: True, 12: False, 17: True, 14: False, 13: True, 9: True, 8: False, 3: True, 2: False, 211: True, 5: True, 4: False, 7: True, 40: False, 39: True, 30: False, 29: True, 38: False, 37: True, 31: True, 32: False, 33: True, 34: False, 45: False, 35: True, 36: False, 212: False, 210: False, 209: True, 213: True, 214: False, 215: True, 47: False, 46: True, 216: False, 217: True, 273: False, 274: True, 218: False, 54: False, 275: False, 71: True, 48: True, 72: False, 53: True, 263: True, 52: False, 262: False, 272: True, 59: False, 60: True, 50: False, 51: True, 208: True, 244: True, 246: False, 56: True, 261: True, 243: False, 65: False, 260: False, 264: False, 258: False, 242: True, 69: False, 245: True, 58: False, 257: True, 241: True, 57: False, 247: True, 259: False, 68: True, 265: True, 64: True, 74: False, 73: True, 75: True, 256: False, 267: False, 248: True, 77: True, 87: False, 253: False, 79: True, 268: True, 85: True, 269: False, 80: True, 86: False, 271: False, 270: True, 88: True, 81: False, 82: True, 92: True, 91: False, 89: False, 90: True, 93: False, 94: True, 219: True, 233: False, 96: True, 95: False, 224: True, 223: False, 221: True, 220: False, 228: True, 222: True, 100: True, 99: False, 97: False, 98: True, 227: False, 103: False, 104: True, 102: True, 101: False, 225: False, 226: True, 232: True, 230: True, 229: False, 231: False, 105: False, 106: True, 107: False, 108: True, 205: True, 115: True, 114: False, 113: True, 112: False, 111: True, 110: False, 200: False, 201: True, 204: False, 203: True, 202: False, 199: True, 122: False, 121: True, 123: True, 194: False, 195: True, 119: True, 120: False, 196: False, 197: True, 191: True, 249: True, 193: True, 192: False, 189: True, 188: False, 187: True, 185: True, 186: False, 132: False, 131: True, 133: True, 134: False, 142: True, 126: False, 125: True, 127: True, 128: False, 143: False, 144: True, 135: True, 136: False, 130: False, 129: True, 137: True, 138: False, 139: False, 145: False, 141: False, 140: True, 149: False, 148: True, 147: False, 146: True, 150: True, 151: False, 152: True, 153: False, 154: True, 155: False, 156: True, 157: False, 158: True, 159: False, 160: True, 161: False, 166: True, 167: False, 168: True, 169: False, 165: False, 178: True, 177: False, 184: False, 162: True, 181: True, 172: True, 171: False, 175: False, 163: False, 164: True, 176: True, 234: False, 174: True, 182: False, 235: True, 251: False, 252: True, 179: False, 170: True, 236: False, 6: False, 10: False, 61: False, 49: True, 63: False, 62: True, 254: False, 70: False, 55: True, 255: False, 67: False, 66: True, 84: False, 266: True, 78: False, 76: False, 83: True, 109: False, 117: True, 118: False, 116: False, 124: False, 173: False, 183: True, 180: False, 250: False, 190: False, 198: False, 207: False, 206: True, 238: False, 239: False, 240: True}
for i, polyline in enumerate(polylines):
    if order_dict[i] is True:
        polyline = polyline[::-1]
    p = Polyline(polyline)
    geos.append(sc.sticky['polyline_to_R'](p))
# ---------- end python_25 ----------
item_2 = ListItem(List=python_23.geos, Index="31", Wrap=True)
item_3 = ListItem(List=python_23.geos, Index="4", Wrap=True)
geo_3 = Geometry(python_23.geos)
explode = Explode(Curve=geo_3, Recursive=True)  # -> Segments, Vertices
item_4 = ListItem(List=python_23.geos, Index="11", Wrap=True)
duppt = RemoveDuplicatePts(Points=explode.Vertices, Tolerance=0.01)
geo_4 = Geometry(rebcrv)

bbox = BoundingBox(Content=geo_4, Plane=PlaneXY(0, 0, 0), UnionBox=True)  # -> Box, Box_2
boxprop = BoxProperties(Box=bbox.Box)  # -> Center, Diagonal, Area, Volume, Degeneracy
move_2 = Move(Geometry=geo_4, Motion=expr("-x", boxprop.Center))  # -> Geometry, Transform

# ---- group: polyline_directions
explode_2 = Explode(Curve=python_25.geos, Recursive=True)  # -> Segments, Vertices
item_5 = ListItem(List=explode_2.Vertices, Index=0, Wrap=True)
item_6 = ListItem(List=explode_2.Vertices, Index="1", Wrap=True)
number_slider_7 = Slider(12, range=0..100)
vec2pt = Vector2Pt(PointA=item_5, PointB=item_6, Unitize=True)  # -> Vector, Length
multiplication_4 = Multiplication(A=vec2pt.Vector, B="0.025")
vdisex = VectorDisplayEx(Point=item_5, Vector=multiplication_4, Colour=RGB(0, 0, 0), Width=2)

# ----
pipe = Pipe(Curve=item_2, Radius=number_slider_3, Caps=0)
pipe_2 = Pipe(Curve=item_3, Radius=number_slider_3, Caps=0)
pipe_3 = Pipe(Curve=item_4, Radius=number_slider_5, Caps=0)  # disabled
geo_5 = Geometry(geo_3)
line = LineSDL(Start=duppt, Direction=Y_2, Length="0.001")
python_26 = GhPythonScript(geos_unordered=geo_3)  # -> out, geos; inputs geos_unordered: list
# ---------- python_26: Python ----------
__author__ = "duch"

import rhinoscriptsyntax as rs

index = [23, 22, 21, 20, 19, 18, 17, 16, 15, 14, 13, 24, 25, 26, 12, 10, 11, 0, 5, 1, 9, 2, 3, 4, 8, 7, 6, 27, 64, 65, 28, 29, 30, 63, 62, 60, 61, 32, 31, 33, 34, 35, 59, 36, 58, 57, 56, 39, 38, 66, 37, 55, 54, 40, 53, 52, 51, 41, 42, 43, 44, 45, 46, 47, 48, 49, 50]

geos = []
for i in index:
    geos.append(geos_unordered[i])
# ---------- end python_26 ----------
multiplication_5 = Multiplication(A=panel_23, B=number_slider)
division_2 = Division(A=len, B=multiplication_5)
panel_25 = Panel(division_2)

# ---- group: reconstrct polylines for correct spacing (continued)
geo_6 = Geometry(move_2.Geometry)
python_27 = GhPythonScript(geos_unrestructed=dam, file_path=panel_12, exp_path=panel_24, dis=multiplication_5)  # -> out, geos; inputs geos_unrestructed: list of Polyline
# ---------- python_27: Python ----------
__author__ = "duch"

import rhinoscriptsyntax as rs
import Rhino.Geometry as rg
import ghpythonlib.components as gh
import os 

geos = []
new_polylines = []
for polyline in geos_unrestructed:
    outcome = gh.DivideDistance(polyline, dis)
    points = outcome[0]
    new_p = []
    for pt in points:
        if type(pt) == rg.Point3d:
           geos.append(pt)
           new_p.append([pt[0], pt[1], pt[2]])
    # new_p = [[pt[0], pt[1], pt[2]] for pt in points]
    # print(new_p)
    new_polylines.append(new_p)

file_name = os.path.abspath(exp_path)
with open(file_name, 'w') as file:
        for polyline in new_polylines:
            polyline_str = '; '.join([','.join(map(str, point)) for point in polyline])
            print(len(polyline))
            # print(polyline_str)
            file.write(polyline_str + "\n")
# ---------- end python_27 ----------
pt_19 = Point(python_27.geos)

# ---- group: features (continued)
python_28 = GhPythonScript(points=pt_19, plane=pl)  # -> out, out_pts; inputs points: list of Point3d, plane: Plane
# ---------- python_28: Python ----------
__author__ = "duch"

import rhinoscriptsyntax as rs
import ghpythonlib.components as gh

import Rhino.Geometry as rg


tol = 3

out_pts = []
for pt in points:
    
    closest_st = plane.ClosestPoint(pt)
    
    dis = pt.DistanceTo(closest_st)
    if dis < tol: 
        out_pts.append(pt)
# ---------- end python_28 ----------
python_29 = GhPythonScript(pts_color=python_28.out_pts, path=panel_21)  # -> out, a; inputs pts_color: list of Point3d
# ---------- python_29: Python ----------
__author__ = "duch"

import rhinoscriptsyntax as rs
import os 
# from compas.utilities import geometric_key

# iterate through the points 
# give the feature a color
file_name = os.path.abspath(path)
with open(file_name, 'w') as file:
    for pt in pts_color:
        color = (0, 255, 255)
        string = ','.join(map(str, pt)) + '; ' + str(','.join(map(str, color)))
        print(string)
        file.write(string + "\n")
# ---------- end python_29 ----------
panel_26 = Panel(python_29.out)

# ----
python_30 = GhPythonScript(x=geo_5, y=panel_14)  # -> out, geos; inputs x: list
# ---------- python_30: Python ----------
__author__ = "duch"

import rhinoscriptsyntax as rs

# sequence = [51, 52, 53, 351, 349, 50, 49, 48, 94, 59, 58, 57, 56, 54, 55, 95, 354, 353]
s = list(y.split(","))
sequence = [int(a) for a in s]

geos = []
for s in sequence:
    geos.append(x[s])
# ---------- end python_30 ----------
python_31 = GhPythonScript(x=geo_5, y=panel_14)  # -> out, geos; inputs x: list
# ---------- python_31: Python ----------
__author__ = "duch"

import rhinoscriptsyntax as rs

sequence = s = list(y.split(","))
sequence = [int(a) for a in s]

    
geos = []
for i in range(len(x)):
    if i not in sequence:
        geos.append(x[i])
# ---------- end python_31 ----------
dam_2 = DataDam(DataA=pt_19, BufferDelay=10000000, BufferMode=0)
item_7 = ListItem(List=python_26.geos, Index=panel_16, Wrap=True)  # disabled
item_8 = ListItem(List=python_26.geos, Index=panel_15, Wrap=True)  # disabled
end_2 = EndPoints(Curve=geo_3)  # -> Start, End

# ---- group: check length, if too big, separate to patches
len_3 = Length(Curve=geo_4)
bnd = Bounds(Numbers=len_3)
panel_27 = Panel(bnd)

# ----
pt_20 = Point(dam_2)
cps = ClosestPoints(Point=pt_5, Cloud=pt_20, Count=3)  # -> flatten(ClosestPoint), CPIndex, Distance
lng = ListLength(List=geo_3)
duppt_2 = RemoveDuplicatePts(Points=cps.ClosestPoint, Tolerance=0.01)
series_2 = Series(Start=0, Step=1, Count=lng)

# ---- group: pts_less_stiff
brep = Brep(<brep referenced from the Rhino model>)
python_32 = GhPythonScript(pts=pt_20, brep=brep, dis=Slider(4.5, range=0..10))  # -> out, sel_pts; inputs pts: list of Point3d, brep: Brep; disabled
# ---------- python_32: Python ----------
__author__ = "duch"

import rhinoscriptsyntax as rs
import Rhino.Geometry as rg
import ghpythonlib.components as gh


sel_pts = []


for pt in pts:
    closest_pt, normal, distance = gh.BrepClosestPoint(pt, brep)
    
    if distance < dis:
            sel_pts.append(pt)
# ---------- end python_32 ----------
pt_21 = Point(python_32.sel_pts)

# ----
pt_22 = Point(end_2.Start)
divlength = DivideLength(Curve=item_7, Length=multiplication_5)  # -> Points, Tangents, Parameters; disabled
divlength_2 = DivideLength(Curve=item_8, Length=multiplication_5)  # -> Points, Tangents, Parameters; disabled
python_33 = GhPythonScript(pts=duppt_2, ref_pts=pt_5, dis="4")  # -> out, sel_pts; inputs pts: list of Point3d, ref_pts: list of Point3d
# ---------- python_33: Python ----------
__author__ = "duch"

import rhinoscriptsyntax as rs
import Rhino.Geometry as rg


sel_pts = []
for pt in pts:
    for ref_pt in ref_pts:
        distance = pt.DistanceTo(ref_pt)

        if distance < dis:
            sel_pts.append(pt)
# ---------- end python_33 ----------
python_34 = GhPythonScript(pts=pt_20, curves=crv_5, dis=multiplication_3)  # -> out, geos, sel_pts; inputs pts: list of Point3d, curves: list of Curve
# ---------- python_34: Python ----------
__author__ = "duch"

import rhinoscriptsyntax as rs
import Rhino.Geometry as rg

geos = []
sel_pts = []
for i, pt in enumerate(pts):
    for curve in curves:
        rc, t = curve.ClosestPoint(pt, True)
        closest_point = curve.PointAt(t)
        # geos.append(closest_point)
        distance = pt.DistanceTo(closest_point)
        
        # print(i, distance)

        if distance < dis:
            sel_pts.append(pt)
# ---------- end python_34 ----------
addition = Addition(A=divlength_2.Parameters, B=number_slider_6)  # disabled
cps_2 = ClosestPoints(Point=pt_6, Cloud=pt_20, Count="1")  # -> flatten(ClosestPoint), CPIndex, Distance
pt_23 = Point(python_34.geos)
pt_24 = Point(python_34.sel_pts)
merge_3 = Merge(Data1=python_33.sel_pts, Data2=pt_24, Data3=merge_2)  # -> flatten(Result)
eval = EvaluateCurve(Curve=item_8, Parameter=addition)  # -> Point, Tangent, Angle; disabled
text = Text(Location=pt_22, Text=series_2, Size="0.02", Bold=False, HorizontalAlignment=0, VerticalAlignment=0)
duppt_3 = RemoveDuplicatePts(Points=cps_2.ClosestPoint, Tolerance=0.01)
python_35 = GhPythonScript(pts_color=merge_3, path=panel_17)  # -> out, a; inputs pts_color: list of Point3d
# ---------- python_35: Python ----------
__author__ = "duch"

import rhinoscriptsyntax as rs
import os 
# from compas.utilities import geometric_key

# iterate through the points 
# give the feature a color
file_name = os.path.abspath(path)
with open(file_name, 'w') as file:
    for pt in pts_color:
        color = (0, 150, 255)
        string = ','.join(map(str, pt)) + '; ' + str(','.join(map(str, color)))
        print(string)
        file.write(string + "\n")
# ---------- end python_35 ----------
pipe_4 = Pipe(Curve=python_31.geos, Radius="0.0026", Caps=0)

lng_2 = ListLength(List=python_31.geos)
series_3 = Series(Start=0, Step=1, Count=lng_2)
gradient = Gradient(LowerLimit=python_31.geos, UpperLimit=lng_2, Parameter=series_3, stops=[0: RGB(0, 0, 0), 0: RGB(255, 254, 254)])
preview = CustomPreview(Geometry=pipe_4, Material=gradient)  # disabled

pipe_5 = Pipe(Curve=python_30.geos, Radius="0.0026", Caps=0)

lng_3 = ListLength(List=python_30.geos)
series_4 = Series(Start=0, Step=1, Count=lng_3)
gradient_2 = Gradient(
    LowerLimit=0,
    UpperLimit=lng_3,
    Parameter=series_4,
    stops=[0: RGB(243, 57, 0), 0.1: RGB(236, 27, 60), 0.2: RGB(210, 0, 118), 0.3: RGB(103, 0, 120), 0.4: RGB(39, 72, 161), 0.5: RGB(1, 192, 229), 0.596: RGB(18, 178, 90), 0.7: RGB(79, 186, 8), 0.8: RGB(220, 237, 32), 0.9: RGB(247, 159, 20), 1: RGB(243, 57, 0)])
preview_2 = CustomPreview(Geometry=pipe_5, Material=graft(gradient_2))  # disabled

python_36 = GhPythonScript(pts_color=pt_20, path=python_13.exp_path)  # -> out, a; inputs pts_color: list of Point3d
# ---------- python_36: Python ----------
__author__ = "duch"

import rhinoscriptsyntax as rs
import os 
# from compas.utilities import geometric_key

# iterate through the points 
# give the feature a color
file_name = os.path.abspath(path)

with open(file_name, 'w') as file:
    for pt in pts_color:
        string = "0 1 0"
        print(string)
        file.write(string + "\n")
# ---------- end python_36 ----------
python_37 = GhPythonScript(pts_color=duppt_3, color_str="(160, 32, 255)", path=panel_19)  # -> out, a; inputs pts_color: list of Point3d
# ---------- python_37: Python ----------
__author__ = "duch"

import rhinoscriptsyntax as rs
import os 
import ast


color_tup = ast.literal_eval(color_str)

# iterate through the points 
# give the feature a color
file_name = os.path.abspath(path)
with open(file_name, 'w') as file:
    for pt in pts_color:
        color = color_tup
        print(color)
        string = ','.join(map(str, pt)) + '; ' + str(','.join(map(str, color)))
        print(string)
        file.write(string + "\n")
# ---------- end python_37 ----------
python_38 = GhPythonScript(pts_color=pt_21, color_str="(255, 105, 180)", path=panel_18)  # -> out, a; inputs pts_color: list of Point3d; same code as python_37
panel_28 = Panel(python_35.out)
panel_29 = Panel(python_38.out)
panel_30 = Panel(python_37.out)

python_39 = GhPythonScript(mesh=data, showvertexlabels=Toggle(False))  # -> R_points, vertexlabels; inputs showvertexlabels: Boolean
# ---------- python_39: Python ----------
__author__ = "duchaoyu"

import scriptcontext as sc

R_points = []
vertexlabels = []

# access vertices
for vkey in mesh.vertices(): # vkey: vertex identifiers
    xyz = mesh.vertex_coordinates(vkey) # vertex coordinates: [x, y, z]
    point = sc.sticky['point_to_R'](xyz) # convert data to Rhino point
    R_points.append(point)
    
    if showvertexlabels:
        vertexlabels.append(str(vkey))
# ---------- end python_39 ----------
python_40 = GhPythonScript(mesh=data, showfacelabels=Toggle(True))  # -> R_face_centroids, facelabels; inputs showfacelabels: Boolean
# ---------- python_40: Python ----------
__author__ = "duchaoyu"

import scriptcontext as sc
import System

R_face_centroids = []
facelabels = []
area = 0

# access faces
for fkey in mesh.faces(): # fkey: face identifiers
    area += mesh.face_area(fkey)
    centroid = mesh.face_centroid(fkey) # centroid point of the mesh face: [x, y, z]
    R_centroid = sc.sticky['point_to_R'](centroid) # convert data to Rhino point
    R_face_centroids.append(R_centroid)
    
    if showfacelabels:
        facelabels.append(str(fkey))

print(area)
# ---------- end python_40 ----------

pt_25 = Point(python_39.R_points)
tag_2 = TextTag3D(
    Location=python_39.R_points,
    Text=python_39.vertexlabels,
    Size=Slider(0.18, range=0..1),
    Colour=ColourSwatch(SwatchColor=RGB(103, 255, 0)),
    Justification=5)

pt_26 = Point(python_40.R_face_centroids)
tag_3 = TextTag3D(
    Location=python_40.R_face_centroids,
    Text=python_40.facelabels,
    Size=Slider(1, range=0..1),
    Colour=ColourSwatch(SwatchColor=RGB(0, 255, 255)),
    Justification=5)
